% Simulink data dictionary sigas_rt.sldd

General_SchemaVersion = Simulink.Parameter(uint16(2), Unit="1")  % Version of MATLAB simulation data schema. Origin: REQUIREMENT: MATLAB migration prompt.
General_ZoneCount = Simulink.Parameter(uint8(3), Unit="1")  % Kitchen, Technical and Living zones. Origin: REQUIREMENT: include/v2/types.h.
GasSensor_AdcMin = Simulink.Parameter(uint16(0), Unit="1")  % Minimum simulated 12-bit ADC code. Origin: V1_COMPATIBILITY: ESP32 ADC abstraction.
GasSensor_AdcMax = Simulink.Parameter(uint16(4095), Unit="1")  % Maximum simulated 12-bit ADC code. Origin: V1_COMPATIBILITY: ESP32 ADC abstraction.
GasSensor_WarningEnter = Simulink.Parameter(uint16(1400), Unit="1")  % Academic warning entry threshold; not calibrated ppm. Origin: V1_COMPATIBILITY: include/config.h.
GasSensor_WarningExit = Simulink.Parameter(uint16(1000), Unit="1")  % Academic warning exit threshold; not calibrated ppm. Origin: V1_COMPATIBILITY: include/config.h.
GasSensor_High = Simulink.Parameter(uint16(3000), Unit="1")  % Academic critical threshold; not calibrated ppm. Origin: V1_COMPATIBILITY: include/config.h.
GasSensor_Severe = Simulink.Parameter(uint16(3900), Unit="1")  % V2 academic severe stimulus threshold. Origin: SIMULATION_ASSUMPTION: include/v2/config.h.
GasSensor_ResponseTau = Simulink.Parameter(1, Unit="s")  % First-order MQ-2 response approximation. Origin: SIMULATION_ASSUMPTION.
GasSensor_NoiseAmplitude = Simulink.Parameter(8, Unit="1")  % Optional bounded ADC noise amplitude. Origin: SIMULATION_ASSUMPTION.
Pressure_NormalSupply = Simulink.Parameter(20, Unit="mbar")  % Nominal source/manifold gauge pressure for scenarios. Origin: SIMULATION_ASSUMPTION: docs/v2/presiones_y_valvulas.md.
Pressure_NormalBranch = Simulink.Parameter(19, Unit="mbar")  % Nominal branch gauge pressure for scenarios. Origin: SIMULATION_ASSUMPTION: docs/v2/presiones_y_valvulas.md.
Pressure_Low = Simulink.Parameter(12, Unit="mbar")  % Academic low pressure classifier threshold. Origin: SIMULATION_ASSUMPTION: include/v2/config.h.
Pressure_SupplyLow = Simulink.Parameter(8, Unit="mbar")  % Academic supply-loss classifier threshold. Origin: SIMULATION_ASSUMPTION: include/v2/config.h.
Pressure_High = Simulink.Parameter(30, Unit="mbar")  % Academic overpressure classifier threshold. Origin: SIMULATION_ASSUMPTION: include/v2/config.h.
Pressure_Max = Simulink.Parameter(40, Unit="mbar")  % Maximum accepted simulated pressure reading. Origin: SIMULATION_ASSUMPTION: include/v2/config.h.
Pressure_Delta = Simulink.Parameter(4, Unit="mbar")  % Minimum manifold-to-branch anomaly delta. Origin: SIMULATION_ASSUMPTION: include/v2/config.h.
Pressure_RapidDrop = Simulink.Parameter(20, Unit="mbar/s")  % Rapid branch pressure drop classifier. Origin: SIMULATION_ASSUMPTION: include/v2/config.h.
Pipe_TrunkLength = Simulink.Parameter(8, Unit="m")  % Configurable academic trunk length. Origin: SIMULATION_ASSUMPTION; Blender geometry is not a certified plan.
Pipe_KitchenLength = Simulink.Parameter(3, Unit="m")  % Configurable kitchen branch length. Origin: SIMULATION_ASSUMPTION.
Pipe_TechnicalLength = Simulink.Parameter(4, Unit="m")  % Configurable technical branch length. Origin: SIMULATION_ASSUMPTION.
Pipe_LivingLength = Simulink.Parameter(4, Unit="m")  % Configurable Living branch length. Origin: SIMULATION_ASSUMPTION.
Pipe_InnerDiameter = Simulink.Parameter(0.015, Unit="m")  % Configurable common pipe inner diameter. Origin: SIMULATION_ASSUMPTION.
Pipe_Roughness = Simulink.Parameter(1.5e-5, Unit="m")  % Configurable equivalent roughness. Origin: SIMULATION_ASSUMPTION.
Pipe_TerminalLoadArea = Simulink.Parameter(1.0e-7, Unit="m^2")  % Equivalent terminal appliance load area for each branch. Origin: SIMULATION_ASSUMPTION; tune only against documented plant targets.
Pipe_LeakAreaClosed = Simulink.Parameter(0, Unit="m^2")  % No-leak restriction area command. Origin: SIMULATION_ASSUMPTION.
Pipe_LeakAreaRupture = Simulink.Parameter(4.0e-5, Unit="m^2")  % Living rupture scenario opening area. Origin: SIMULATION_ASSUMPTION; produces a localized PL drop below 12 mbar while P1 remains above 12 mbar.
Valve_OpenCommand = Simulink.Parameter(true, DataType="boolean", Unit="1")  % Logical open valve command. Origin: REQUIREMENT: single actuation layer.
Valve_ClosedCommand = Simulink.Parameter(false, DataType="boolean", Unit="1")  % Logical closed valve command. Origin: REQUIREMENT: fail-safe actuation.
Timing_GasSample = Simulink.Parameter(0.1, Unit="s")  % Gas acquisition period. Origin: V1_COMPATIBILITY: include/config.h.
Timing_PressureSample = Simulink.Parameter(0.05, Unit="s")  % Pressure acquisition period. Origin: REQUIREMENT: docs/v2/tareas_freertos_v2.md.
Timing_Diagnostics = Simulink.Parameter(0.5, Unit="s")  % Diagnostics activity period. Origin: V1_COMPATIBILITY: include/config.h.
Timing_SensorTimeout = Simulink.Parameter(0.35, Unit="s")  % Gas sensor freshness timeout. Origin: V1_COMPATIBILITY: include/config.h.
Timing_PressureTimeout = Simulink.Parameter(0.175, Unit="s")  % Pressure sensor freshness timeout. Origin: REQUIREMENT: include/v2/config.h.
Timing_PostConfirmationDeadline = Simulink.Parameter(0.5, Unit="s")  % Academic post-confirmation deadline. Origin: REQUIREMENT: RT-03; not WCET/WCRT.
StateMachine_CriticalSamples = Simulink.Parameter(uint8(3), Unit="1")  % Consecutive high gas samples required. Origin: V1_COMPATIBILITY: include/config.h.
StateMachine_PressureSamples = Simulink.Parameter(uint8(3), Unit="1")  % Consecutive pressure anomaly samples required. Origin: REQUIREMENT: include/v2/config.h.
StateMachine_RearmSamples = Simulink.Parameter(uint8(3), Unit="1")  % Consecutive safe samples required before reset. Origin: V1_COMPATIBILITY: include/config.h.
StateMachine_ResetDebounce = Simulink.Parameter(uint8(2), Unit="1")  % Manual reset debounce samples. Origin: V1_COMPATIBILITY: include/config.h.
Telemetry_SchemaVersion = Simulink.Parameter(uint16(2), Unit="1")  % Versioned MATLAB_SIM telemetry schema. Origin: REQUIREMENT: MATLAB migration prompt.
Test_DefaultStopTime = Simulink.Parameter(12, Unit="s")  % Finite stop time for single scenarios. Origin: SIMULATION_ASSUMPTION.
Test_FullDemoStopTime = Simulink.Parameter(55, Unit="s")  % Finite stop time for V2 full demonstration. Origin: SIMULATION_ASSUMPTION.